# Grasshopper definition addTwoNumebrs.gh (Grasshopper 1.0.7)

num1 = Slider(0, range=0..100)
num2 = Slider(100, range=0..100)
result = Addition(A=num1, B=num2)
result_2 = Panel(result)
context_print = ContextPrint(Text=result)
