# Grasshopper definition addTwoNumebrsC#.gh (Grasshopper 1.0.7)

num2 = Slider(0, range=0..100)
num1 = Slider(0, range=0..100)
addition = CSharpScript(num1=num1, num2=num2)  # -> out, result; inputs num1: Double, num2: Double
# ---------- addition: C# ----------
    result = num1 + num2;
# ---------- end addition ----------
result = Number(addition.result)
