# Grasshopper definition rhinoinsideTestFIle.gh (Grasshopper 1.0.7)

radius = Slider(13, range=0..100)
num2 = Slider(0, range=0..100)
num1 = Slider(0, range=0..100)
xy = XYPlane(Origin=Point(0, 0, 0))
makesphere = CSharpScript(location=xy, radius=radius, Reference="C:\Program Files\Rhino 7\System\Newtonsoft.Json.Bson.Rhino.dll")  # -> out, outputString, result; inputs location: Plane, radius: Double
# ---------- makesphere: C# usings ----------
using System.Linq;
using Newtonsoft.Json;
# ---------- makesphere: C# ----------
    Sphere sphere = new Sphere(location, radius);

    result = sphere;

    Mesh mesh = Mesh.CreateFromBrep(sphere.ToBrep(), MeshingParameters.FastRenderMesh).First();
    Rhino.FileIO.SerializationOptions options = new Rhino.FileIO.SerializationOptions();
    options.RhinoVersion = 4;
    options.WriteUserData = true;
    outputString = mesh.ToJSON(options);

    using (System.IO.StreamWriter file =
        new System.IO.StreamWriter(@"C:\Download\test.txt")) {
      file.WriteLine(mesh.ToJSON(options));
    }
# ---------- end makesphere ----------
addition = CSharpScript(num1=num1, num2=num2)  # -> out, result; inputs num1: Double, num2: Double
# ---------- addition: C# ----------
    result = num1 + num2;
# ---------- end addition ----------
result = Number(addition.result)
outputstring = Text(makesphere.outputString)
resultsphere = Mesh(makesphere.result)
area = Area(Geometry=resultsphere)  # -> Area, Centroid
